# Dynamo graph AddAttributeToXML.dyn (Dynamo 2.3.0.5885)

xml = StringInput("""<?xml version="1.0"?>
<svg height="210" width="500">
<g>
  <polygon points="200,10 250,190 160,210" style="fill:lime;stroke:purple;stroke-width:1" /> 
  <polygon points="200,10 250,190 160,210" style="fill:lime;stroke:purple;stroke-width:1" />
  <polygon points="200,10 250,190 160,210" style="fill:lime;stroke:purple;stroke-width:1" />
</g>
</svg>""")
ids = CodeBlock { ["1","2","3"]; }
titles = CodeBlock { ["a","b","c"]; }
python_script = Python(IN[0]=xml, IN[1]=ids, IN[2]=titles)
# ---------- python_script.python (31 lines) ----------
# Load the Python Standard and DesignScript Libraries
import sys

sys.path.append('C:\Program Files\Autodesk\Revit 2020\AddIns\DynamoForRevit')
import xml.etree.ElementTree as ET

# z IN[0] načítám xml typu svg
uniStr = IN[0]
tree = ET.ElementTree(ET.fromstring(uniStr))
root = tree.getroot()
svg = root.getchildren()[0]
i=0
for g in svg:
	polygons = g.iter("polygon")
	#projíždím všechny polygony
	for polygon in polygons:
		#do polygonu přidávám atribut title a id
		polygon.set("title",IN[2][i])
		polygon.set("id",IN[1][i])
		i=i+1

#zpětně přečtu, co je zapsáno v xml
list = []
for g in svg:
	polygons = g.iter("polygon")
	for polygon in polygons:
		list.append(polygon.attrib)
	
#uloží změněné xml do souboru
#tree.write("C:\Test\output.xml",xml_declaration=True,encoding='utf-8')
OUT = ET.tostring(root,'utf-8','xml')
# ----------------------------------------
code_block = CodeBlock(svgtext=python_script) { svgtext; }
