# Dynamo graph Room-GetBoundarySegments.dyn (Dynamo 2.3.0.5885)

code_block = CodeBlock {  }
select_room_element = DSModelElementSelection()  # 1 picked in the model
python_script = Python(IN[0]=select_room_element)
# ---------- python_script.python (21 lines) ----------
# Load the Python Standard and DesignScript Libraries
import sys
import clr
clr.AddReference('RevitAPI')
from Autodesk.Revit.DB import *

clr.AddReference("RevitServices")
import RevitServices
from RevitServices.Persistence import DocumentManager
doc = DocumentManager.Instance.CurrentDBDocument;

DYNroom = IN[0]
room = DYNroom.InternalElement
opt = SpatialElementBoundaryOptions()
bounds = room.GetBoundarySegments(opt)
elements = []
for innerlist in bounds :
	for bound in innerlist :
		elements.append(doc.GetElement(bound.ElementId))

OUT = elements
# ----------------------------------------
