# Dynamo graph schedule_template_copy_script.dyn (Dynamo 2.3.0.5885)

template_schedule = DSModelElementSelection()  # 1 picked in the model
name = StringInput("Name")
target_schedule = DSModelElementSelection()  # 1 picked in the model
python_script = Python(IN[0]=template_schedule, IN[1]=name, IN[2]=target_schedule)
# ---------- python_script.python (56 lines) ----------
import sys
import clr
clr.AddReference('ProtoGeometry')
clr.AddReference('RevitServices')
from RevitServices.Persistence import DocumentManager

clr.AddReference("RevitAPI")
import Autodesk
from Autodesk.Revit.DB import *
from Autodesk.DesignScript.Geometry import *


#######################################
##### SCRIPT MADE BY VACLAV SMOLIK ####
#######################################
# WWW.BIMTWIN.CZ | WWW.VASEKSMOLIK.CZ #
#######################################
####### PLEASE DO NOT REMOVE ##########
####### THIS TEXT FROM SCRIPT #########
#######################################

doc = DocumentManager.Instance.CurrentUIDocument.Document;
uiapp = DocumentManager.Instance.CurrentUIApplication
app = uiapp.Application

# Input
template_grid = UnwrapElement(IN[0])
name = IN[1]
target_grid = UnwrapElement(IN[2])

template_scheduleView = doc.GetElement(template_grid.ScheduleId)
target_scheduleView = doc.GetElement(target_grid.ScheduleId)

template_definition = template_scheduleView.Definition
target_definition = target_scheduleView.Definition

# transaction
trans1 = Transaction(doc, 'Copy schedule template')
trans1.Start()
try:
	target_definition.ClearFields()
	for field_id in template_definition.GetFieldOrder():
		field = template_definition.GetField(field_id)
		
		for new_schedulable_field in target_definition.GetSchedulableFields():
			if field.GetSchedulableField() == new_schedulable_field:
				new_field = target_definition.AddField(new_schedulable_field)	
				new_field.GridColumnWidth = field.GridColumnWidth	

	target_scheduleView.Name = name
	trans1.Commit()
	OUT = target_grid
	
except Exception as e:
	trans1.RollBack()
	raise e
# ----------------------------------------
watch = Watch(python_script)
